# Dynamo graph dynamo.dyn "some_name" (Dynamo 2.19.3.6394)

unique = Python()  # IronPython2; unwired: IN[0]
# ---------- unique.python (12 lines) ----------
Definitions = IN[0]

Unique = []
Added = []

for elem in Definitions:
	if elem.Name in Added:
		continue
	Added.append(elem.Name)
	Unique.append(elem)

OUT = sorted(Unique, key=lambda ele: ele.Name)
# ----------------------------------------
